# Grasshopper definition fastPointSearch.gh (Grasshopper 1.0.8)
# Copyright: Mcgregor Coxall
# plug-ins: RhinoCodePluginGH

number_slider = Slider(166, range=0..500)
crv = Curve([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])
pt = Point(Point(0, 0, 0))
arrrec = RectangularArray(Geometry=pt, Cell={Plane=PlaneXY(0, 0, 0), Size=Domain2(u=0..10, v=0..5)}, XCount=number_slider, YCount=number_slider)  # -> Geometry, Transform
incurves = PointInCurves(Point=arrrec.Geometry, Curves=crv)  # -> Relationship, Index, Point
py3 = Python3Script(C=crv, P=arrrec.Geometry)  # -> i; inputs C: list of Curve, P: list of Point3d
#   port C: closed curves to search
#   port P: points to search
# ---------- py3: Python ----------
import Rhino.Geometry as rg
import ghpythonlib.parallel as p

i = []

rt = rg.RTree.CreateFromPointArray(P)

def pointSearch(sender, e):
    i.append(e.Id)

for bound in C:
    bb = bound.GetBoundingBox(False)
    rt.Search(bb, pointSearch)

i = list(set(i))
# ---------- end py3 ----------
item = ListItem(List=arrrec.Geometry, Index=py3, Wrap=True)
